# Grasshopper definition CompECD_ehub_template.gh (Grasshopper 1.0.7)
# plug-ins: EaCS3EHub

# ---- group: drybulb
data = Data([5.2, 4.9, 4.5, 4.4, 4.2, 4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])

# ----
# CARRIERS
panel = Panel("500000")
naturalgas = NaturalGasCarrier(Price="0.12", Emissions="0.228", YearlyNaturalGas=1.797693135e+308)
biomass = BiomassCarrier(Price="0.125", Emissions="0.027", YearlyBiomass=panel)
electricity = ElectricityCarrier(Price="0.237", Emissions="0.121")
air = AirCarrier(AmbientAirTemperature=data)

# ---- group: ideal heating loads (kWh)
data_2 = Data([0, 0, 0, 0, 0, 0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])

# ---- group: ideal cooling loads (kWh)
data_3 = Data([0, 0, 0, 0, 0, 0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])

# ---- group: domestic hot water (kWh)
data_4 = Data([22.083, 23.832, 17.512, 18.092, 18.113, 27.492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])

# ---- group: electricity plug loads (kWh)
data_5 = Data([346.461, 346.462, 346.458, 346.453, 346.453, 394.077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])

# ----
# DEMAND
panel_2 = Panel("Electricity")
demand = Demand(TimeSeries=data_2, DemandType="Heating")
demand_2 = Demand(TimeSeries=data_3, DemandType="Cooling")
demand_3 = Demand(TimeSeries=data_4, DemandType="HotWater")
demand_4 = Demand(TimeSeries=data_5, DemandType=panel_2)

# ---- group: sol2
data_6 = Data([0, 0, 0, 0, 0, 0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])

# ---- group: sol1
data_7 = Data([0, 0, 0, 0, 0, 0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])

# ---- group: sol3
data_8 = Data([0, 0, 0, 0, 0, 0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])

# ----
# SOLAR
solar = SolarCarrier(Irradiation=data_8)
solar_2 = SolarCarrier(Irradiation=data_6)
solar_3 = SolarCarrier(Irradiation=data_7)

# ----
# RETROFITS
panel_3 = Panel("Retrofit Package 1")
building = BuildingPackage(
    Name=panel_3,
    Loads=[demand, demand_2, demand_3, demand_4],
    ConstructionCost="100000",
    EmbodiedEmissions="200000",
    Lifetime="80")

# ----
# CONVERSION
panel_4 = Panel("1020")
ashp = AirSourceHeatPump(
    FixCost="18300",
    LinearCost=panel_4,
    EmbodiedEmissions="75",
    MinimumCapacity="1",
    Lifetime="15",
    OMCost="0.01",
    AmbientAir=air,
    Electricity=electricity,
    SupplyTemperature=65,
    Pi1="13.39",
    Pi2="-0.047",
    Pi3="1.109",
    Pi4="0.012")  # -> AirSourceHeatPump, COP
graph = QuickGraph(ashp.COP, SortOrder=0)

# ----
# SOLVER
panel_5 = Panel("C:\Users\chwaibel\Documents\GitHub\GH_EHub\EaCS3EHub")
ehub2022 = EnergyHubCompECDHS2022(Building=building, Conversion=ashp.AirSourceHeatPump, Epsilon="3", Folder=panel_5, Run=Toggle(False))  # -> CAPEX, OPEX, Emissions
