# Grasshopper definition eacs3_ehub_template.gh (Grasshopper 1.0.7)
# plug-ins: EaCS3EHub, GHSolar

panel = Panel("C:\Users\Christoph\Desktop\solarPot3.txt")  # disabled

# ---- group: sol3
data = Data([0, 0, 0, 0, 0, 0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])

# ---- group: sol2
data_2 = Data([0, 0, 0, 0, 0, 0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])

# ---- group: sol1
data_3 = Data([0, 0, 0, 0, 0, 0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])

# ----
flatten = FlattenTree(Tree=data_3, Path="{0}")
flatten_2 = FlattenTree(Tree=data_2, Path="{1}")
flatten_3 = FlattenTree(Tree=data, Path="{2}")
readtxt = ReadText(Path=panel)  # disabled
panel_2 = Panel("""15.3
24.38
85.1""")
data_4 = Data([flatten, flatten_2, flatten_3])

# ---- group: elec
data_5 = Data([346.461, 346.462, 346.458, 346.453, 346.453, 394.077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])

# ---- group: dhw
data_6 = Data([22.083, 23.832, 17.512, 18.092, 18.113, 27.492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])

# ---- group: htg
data_7 = Data([0, 0, 0, 0, 0, 0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])

# ---- group: clg
data_8 = Data([0, 0, 0, 0, 0, 0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])

# ---- group: drybulb
data_9 = Data([5.2, 4.9, 4.5, 4.4, 4.2, 4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])

# ---- group: ghi
data_10 = Data([0, 0, 0, 0, 0, 0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])

# ----
ehub2021 = EnergyHubEaCS3HS2021(
    TechFile="C:\Users\Christoph\Desktop\ehub_EaCS3\",
    HeatingLoads=data_7,
    CoolingLoads=data_8,
    DHWLoads=data_6,
    ElectricityLoads=data_5,
    SolarTechAreas=panel_2,
    SolarPotentials=data_4,
    GHI=data_10,
    DryBulb=data_9,
    Run=Toggle(False),
    Epsilon="3")  # -> CAPEX, OPEX, Emissions
addition = Addition(A=ehub2021.CAPEX, B=ehub2021.OPEX)
graph = QuickGraph(addition, SortOrder=0)
graph_2 = QuickGraph(ehub2021.Emissions, SortOrder=0)
