# Grasshopper definition template.gh (Grasshopper 1.0.7)
# plug-ins: EaCS3EHub

panel = Panel("""0
1
2""")
panel_2 = Panel("C:\Users\chwaibel\AppData\Roaming\Grasshopper\Libraries\ehub\netcoreapp3.0\CISBAT21.exe")
ehub2021 = EnergyHubEaCS3HS2021(
    Directory=panel_2,
    HeatingLoads=panel,
    CoolingLoads=panel,
    DHWLoads=panel,
    ElectricityLoads=panel,
    SolarTechAreas=panel,
    SolarPotentials=panel,
    Run=Toggle(False))  # -> CostInstall, CostOperation, EmissionsInstall, EmissionsOperation
